# Grasshopper definition angled_lengths_polyline.gh (Grasshopper 1.0.8)
# plug-ins: RhinoCodePluginGH

startpt = StartPt()
startdir = StartDir()
startlength = StartLength()
rotationdegrees = RotationDegrees()
remaininglengths = RemainingLengths()
close = Close()
plane = Plane()
startlength_2 = CSharpScript(
    StartPt=startpt,
    StartDir=startdir,
    Plane=plane,
    StartLength=startlength,
    RotationDegrees=rotationdegrees,
    RemainingLengths=remaininglengths,
    Close=close)  # -> out, Polyline; inputs StartPt: Point3d, StartDir: Vector3d, Plane: Plane, StartLength: Double, RotationDegrees: list of Double, RemainingLengths: list of Double, Close: Boolean
# ---------- startlength_2: C# ----------
// Grasshopper Script Instance
using System;
using System.Collections;
using System.Collections.Generic;
using System.Drawing;

using Rhino;
using Rhino.Geometry;

using Grasshopper;
using Grasshopper.Kernel;
using Grasshopper.Kernel.Data;
using Grasshopper.Kernel.Types;
using System.Linq;

public class Script_Instance : GH_ScriptInstance
{
  /* 
    Members:
      RhinoDoc RhinoDocument
      GH_Document GrasshopperDocument
      IGH_Component Component
      int Iteration

    Methods (Virtual & overridable):
      Print(string text)
      Print(string format, params object[] args)
      Reflect(object obj)
      Reflect(object obj, string method_name)
  */
  
  private void RunScript(
	Point3d StartPt,
	Vector3d StartDir,
	Plane Plane,
	double StartLength,
	IList<double> RotationDegrees,
	IList<double> RemainingLengths,
	bool Close,
	ref object Polyline)
  {
    double tol = RhinoDoc.ActiveDoc.ModelAbsoluteTolerance;

    try
    {
        Plane plane = (Plane == Plane.Unset || Plane.Normal.Length < tol) ? Plane.WorldXY : Plane;

        Vector3d startDir = new Vector3d(StartDir);
        startDir.Unitize();

        // Notes:
        // - the rotation is always in counter-clockwise
        if (StartLength <= tol || StartDir.Length < tol) return;
        else if ((RotationDegrees == null && RemainingLengths == null)
            || (RotationDegrees == null && RemainingLengths != null) 
            || (RotationDegrees != null && RemainingLengths == null))
        {
            Polyline = new LineCurve(StartPt, StartPt + startDir * StartLength);
            return;
        }

        var pts = new List<Point3d>() { StartPt, StartPt + (startDir * StartLength) };

        int numRemaining = Math.Min(RotationDegrees.Count, RemainingLengths.Count);
        
        Point3d prevPt = pts.Last();
        Vector3d prevDir = StartDir;
        for (int i = 0; i < numRemaining; i++)
        {
            var radians = RotationDegrees[i] * Math.PI / 180;
            var newDir = new Vector3d(prevDir);
            newDir.Rotate(radians, plane.Normal);
            newDir.Unitize();

            var newPt = prevPt + newDir * RemainingLengths[i];        
            pts.Add(newPt);
            
            prevDir = newDir;
            prevPt = newPt;
        }

        if (Close)
        {
            pts.Add(pts.First());
        }
        Polyline = new PolylineCurve(pts);
    }
    catch(Exception ex)
    {
        Print(ex.Message);
    }
  }
}
# ---------- end startlength_2 ----------
polyline = Polyline(startlength_2.Polyline)
out = Out(startlength_2.out)
