# Grasshopper definition app_insights_duration_by_tags_logging_example.gh (Grasshopper 1.0.7)
# Example for a Hops definition which logs its solution duration and given tags to Azure Application Insights, enabling the demand on the Rhino Compute service to be traced back to individual teams/projects.
# 
# Note: the Instrumentation Key has been left blank here and you'd need to set up the Application Insights resource in your Azure Portal before being able to use this.

example_tag_string_delimited_by_semi_col = Panel("ExampleTag1:First example value;ExampleTag2:Second example value")  # "Example tag string - delimited by semi-colons"
example_inputs = Panel("1")
numseconds = GetNumber(example_inputs, AtLeast=1, AtMost=1, Maximum=1.797693135e+308, Minimum=-1.797693135e+308, TreeAccess=False)
tags = GetString(example_tag_string_delimited_by_semi_col, AtLeast=1, AtMost=1, TreeAccess=False)

# ---- group: Pass all inputs through this gate to record start time of solution
merge = Merge(Data1=numseconds, Data2=tags)
time_gate = TimeGate(D=merge)  # -> D_4, utc_2
item = ListItem(List=time_gate.D_4, Index=0, Wrap=True)  # -> Item, Item1
start_time = Time(time_gate.utc_2)
tags_2 = Text(item.Item1)

# ---- group: Main GH logic goes here - this is just a simple example
sleep = CSharpScript(NumSeconds=item.Item)  # -> out, Debug; inputs NumSeconds: Int32
# ---------- sleep: C# ----------
    System.Threading.Thread.Sleep(NumSeconds * 1000);
    Debug = "Slept for " + NumSeconds + " seconds";
# ---------- end sleep ----------

# ---- group: Main GH logic goes here - this is just a simple example / RH_OUT:Debug
txt = Text(sleep.Debug)

# ---- group: Send log to Azure App Insights
time_gate_2 = TimeGate(D=txt)  # -> D_4, utc_2
start_time_2 = Time(start_time)
azure_app_insights_instrumentation_key = Panel("[Insert your key here]")

# ---- group: Send log to Azure App Insights / Add duration as an additional tag
time_span = TimeSpan(start=start_time_2, end=time_gate_2.utc_2)
tags_passed_in = Text(tags_2)
concat = Concatenate(FragmentA="Duration:", FragmentB=time_span, FragmentC=";", FragmentD=tags_passed_in)

# ---- group: Send log to Azure App Insights (continued)
final_tag_string = Panel(concat)
log_app_insights = LogAzureApplicationInsights(D=time_gate_2.D_4, tagstr=concat, instkey=azure_app_insights_instrumentation_key)

# ==== cluster TimeGate: Pass-through gate which outputs UTC time of it being solved. This is useful in constructing durations of scripts on Rhino Compute in conjunction with the Time Span and Log Azure Application Insights clusters.
D = ClusterInput()
D_2 = Data(D)
c_script = CSharpScript(Inputs=D_2)  # -> out, Inputs_out, TimeNowUtc; inputs Inputs: tree
# ---------- c_script: C# ----------
    TimeNowUtc = DateTime.UtcNow;
    Inputs_out = Inputs;
# ---------- end c_script ----------
utc = Time(c_script.TimeNowUtc)
D_3 = Data(c_script.Inputs_out)
D_4 = ClusterOutput(D_3)
utc_2 = ClusterOutput(utc)

# ==== cluster TimeSpan: Subtracts end time from a start time and returns a TimeSpan.
start = ClusterInput()
end = ClusterInput()
timespan = CSharpScript(Start=start, End=end)  # -> out, Span
# ---------- timespan: C# ----------
    Span = (End - Start);
# ---------- end timespan ----------
span = ClusterOutput(timespan.Span)

# ==== cluster LogAzureApplicationInsights: This sends a custom log event to Azure App Insights using the given Instrumentation Key and a string containing semi-colon separated key:value pairs. Notes: - No quotation marks are needed and colons in values are ok but not in the keys. - The first colon is used to delinate key and value.
instkey = ClusterInput()
tagstr = ClusterInput()
D = ClusterInput()
instkey_2 = Text(instkey)
tagstr_2 = Text(tagstr)
D_2 = Data(D)
log_appinsights = CSharpScript(Outputs=D_2, TagStr=tagstr_2, InstrumentationKey=instkey_2)  # -> out, Debug; inputs Outputs: tree, TagStr: String, InstrumentationKey: String
# ---------- log_appinsights: C# usings ----------
using System.Threading.Tasks;
using GH_IO;
using GH_IO.Serialization;
using System.Linq;
# ---------- log_appinsights: C# ----------
    if (string.IsNullOrEmpty(InstrumentationKey)) return;

    try
    {
      Dictionary<string, string> properties = new Dictionary<string, string>();

      if (!string.IsNullOrEmpty(TagStr))
      {
        var tagPairs = TagStr.Split(';');
        foreach (var pair in tagPairs)
        {
          var firstColonIndex = pair.IndexOf(':');
          if (firstColonIndex >= 0)
          {
            var key = pair.Substring(0, firstColonIndex);
            var val = pair.Substring(firstColonIndex + 1);
            properties[key] = val;
          }
        }
      }

      string sendDebug = Task.Run(() => SendLogMessage(InstrumentationKey, properties)).Result;
      Debug = string.IsNullOrEmpty(sendDebug) ? "Log message sent successfully." : sendDebug;
    }
    catch (Exception ex)
    {
      Debug = "Failed to send log message: " + ex.Message
        + ((ex.InnerException == null) ? "" : " Inner: " + ex.InnerException.Message);
    }
# ---------- log_appinsights: C# additional code ----------
  public static string logUrl = "https://dc.services.visualstudio.com/v2/track";

  // Function to send log message to Azure Application Insights
  public string SendLogMessage(string instrumentationKey, Dictionary<string, string> properties)
  {
    string sendDebug = "";

    try
    {
      var propertyEntries = properties.Select(kvp => "\"" + kvp.Key + "\":\"" + kvp.Value + "\"");
      var propertiesJson = String.Join(",", propertyEntries);

      var logMessage = "{"
        + "\"name\":\"Microsoft.ApplicationInsights.Event\","
        + "\"time\":\"" + DateTime.UtcNow.ToString("O") + "\","
        + "\"iKey\":\"" + instrumentationKey + "\","
        + "\"data\":{"
        + "\"baseType\":\"EventData\","
        + "\"baseData\":{"
        + "\"ver\":2,"
        + "\"name\":\"Custom Log\","
        + "\"properties\":{" + propertiesJson + "}"
        + "}"
        + "}"
        + "}";

      var data = System.Text.Encoding.UTF8.GetBytes(logMessage);

      var request = System.Net.WebRequest.Create(logUrl);
      request.Method = "POST";
      request.ContentType = "application/json";
      request.Headers.Add("X-Api-Key", instrumentationKey);
      request.ContentLength = data.Length;

      using (var stream = request.GetRequestStream())
      {
        stream.Write(data, 0, data.Length);
      }

      using (var response = request.GetResponse() as System.Net.HttpWebResponse)
      {
        if (response.StatusCode != System.Net.HttpStatusCode.OK)
        {
          throw new Exception("Failed to send log message. Status code: " + response.StatusCode);
        }
      }
    }
    catch (Exception ex)
    {
      sendDebug = ex.Message + ".  Stack Trace: " + ex.StackTrace;
      if (ex.InnerException != null)
      {
        sendDebug += ". InnerException: " + ex.InnerException.Message;
      }
    }
    return sendDebug;
  }
# ---------- end log_appinsights ----------
debug = ClusterOutput(log_appinsights.Debug)
panel = Panel(log_appinsights.out)
