# Grasshopper definition bake_geometry.gh (Grasshopper 1.0.7)

geo = Geo()
lns = LNs()
go = Go()
bake_geo = CSharpScript(Geo=geo, LNs=lns, Go=go)  # -> out; inputs Geo: list, LNs: list of String, Go: Boolean
# ---------- bake_geo: C# usings ----------
using System.Linq;
using System.Drawing;
# ---------- bake_geo: C# ----------
    if (!Go) return;

    int numPairs = Math.Min(Geo.Count, LNs.Count);
    RhinoDoc doc = Rhino.RhinoDoc.ActiveDoc;
    if (doc == null) return;

    Dictionary<string, int> indexByLN = new Dictionary<string, int>();

    foreach (string ln in LNs.Distinct())
    {
      int index = -1;
      Rhino.DocObjects.Layer foundLayer = doc.Layers.FindName(ln);
      if (foundLayer == null)
      {
        Color colour = Color.Black;
        if (ln.ToLower().Contains("pocket"))
          colour = Color.Red;
        //Add in other colour defaults here
        
        index = doc.Layers.Add(ln, colour);
      }
      else
      {
        index = foundLayer.Index;
      }
      indexByLN.Add(ln, index);
    }

    for (int i = 0; i < numPairs; i++)
    {
      if (Geo[i] is GeometryBase)
      {
        GeometryBase g = (GeometryBase) Geo[i];
        Rhino.DocObjects.ObjectAttributes att = new Rhino.DocObjects.ObjectAttributes();
        att.LayerIndex = indexByLN[LNs[i]];
        doc.Objects.Add(g, att);
      }
    }
# ---------- end bake_geo ----------
