# Grasshopper definition flatcap_two_piece_example.gh (Grasshopper 1.0.7)
# plug-ins: FlatCap, Human

material_thickness = Panel("18")
left_curves = Curve([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])
left_curve_layer_names = Text(["Profile outside", "Pocket 15mm depth", "Pocket 15mm depth", "Pocket 4mm depth"])
right_curves = Curve([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])
right_curve_layer_names = Text(["Profile outside", "Pocket 15mm depth"])
thickness = Number(material_thickness)

# ---- group: Left piece
left_curves_2 = Curve(left_curves)
left_curve_layer_names_2 = Text(left_curve_layer_names)
thickness_2 = Number(material_thickness)
cncsim = CNCSimulate(Geometry=left_curves_2, LayerNames=left_curve_layer_names_2, Thicknesses=thickness_2, Debug=False, Go=True)  # -> ModelBreps, FailedBreps, R, DebugLayers, DebugObjects
brep = Brep(cncsim.ModelBreps)

# ---- group: Right piece
right_curves_2 = Curve(right_curves)
right_curve_layer_names_2 = Text(right_curve_layer_names)
thickness_3 = Number(material_thickness)
cncsim_2 = CNCSimulate(Geometry=right_curves_2, LayerNames=right_curve_layer_names_2, Thicknesses=thickness_3, Debug=False, Go=True)  # -> ModelBreps, FailedBreps, R, DebugLayers, DebugObjects
brep_2 = Brep(cncsim_2.ModelBreps)

# ---- group: Bake to Rhino file
left_curves_3 = Curve(left_curves)
right_curves_3 = Curve(right_curves)
left_curve_layer_names_3 = Text(["Profile outside", "Pocket 15mm depth", "Pocket 15mm depth", "Pocket 4mm depth"])
right_curve_layer_names_3 = Text(["Profile outside", "Pocket 15mm depth"])
bake = Button()
merge = Merge(Data1=left_curves_3, Data2=right_curves_3)
merge_2 = Merge(Data1=left_curve_layer_names_3, Data2=right_curve_layer_names_3)
cluster = Cluster(geo=merge, lns=merge_2, go=bake)

# ----
layers = CreateModifyLayers(DeleteLayer=False, enableFullPath=False)  # -> LayerNames, LayerFullPath

# ==== cluster Cluster
geo = ClusterInput()
lns = ClusterInput()
go = ClusterInput()
bake_geo = CSharpScript(Geo=geo, LNs=lns, Go=go)  # -> out; inputs Geo: list, LNs: list of String, Go: Boolean
# ---------- bake_geo: C# usings ----------
using System.Linq;
using System.Drawing;
# ---------- bake_geo: C# ----------
    if (!Go) return;

    int numPairs = Math.Min(Geo.Count, LNs.Count);
    RhinoDoc doc = Rhino.RhinoDoc.ActiveDoc;
    if (doc == null) return;

    Dictionary<string, int> indexByLN = new Dictionary<string, int>();

    foreach (string ln in LNs.Distinct())
    {
      int index = -1;
      Rhino.DocObjects.Layer foundLayer = doc.Layers.FindName(ln);
      if (foundLayer == null)
      {
        Color colour = Color.Black;
        if (ln.ToLower().Contains("pocket"))
          colour = Color.Red;
        //Add in other colour defaults here
        
        index = doc.Layers.Add(ln, colour);
      }
      else
      {
        index = foundLayer.Index;
      }
      indexByLN.Add(ln, index);
    }

    for (int i = 0; i < numPairs; i++)
    {
      if (Geo[i] is GeometryBase)
      {
        GeometryBase g = (GeometryBase) Geo[i];
        Rhino.DocObjects.ObjectAttributes att = new Rhino.DocObjects.ObjectAttributes();
        att.LayerIndex = indexByLN[LNs[i]];
        doc.Objects.Add(g, att);
      }
    }
# ---------- end bake_geo ----------
