# Grasshopper definition log_azure_application_insights.gh (Grasshopper 1.0.7)

instkey = Text()
tagstr = Text()
D = Data()
instkey_2 = Text(instkey)
tagstr_2 = Text(tagstr)
D_2 = Data(D)
log_appinsights = CSharpScript(Outputs=D_2, TagStr=tagstr_2, InstrumentationKey=instkey_2)  # -> out, Debug; inputs Outputs: tree, TagStr: String, InstrumentationKey: String
# ---------- log_appinsights: C# usings ----------
using System.Threading.Tasks;
using GH_IO;
using GH_IO.Serialization;
using System.Linq;
# ---------- log_appinsights: C# ----------
    if (string.IsNullOrEmpty(InstrumentationKey)) return;

    try
    {
      Dictionary<string, string> properties = new Dictionary<string, string>();

      if (!string.IsNullOrEmpty(TagStr))
      {
        var tagPairs = TagStr.Split(';');
        foreach (var pair in tagPairs)
        {
          var firstColonIndex = pair.IndexOf(':');
          if (firstColonIndex >= 0)
          {
            var key = pair.Substring(0, firstColonIndex);
            var val = pair.Substring(firstColonIndex + 1);
            properties[key] = val;
          }
        }
      }

      string sendDebug = Task.Run(() => SendLogMessage(InstrumentationKey, properties)).Result;
      Debug = string.IsNullOrEmpty(sendDebug) ? "Log message sent successfully." : sendDebug;
    }
    catch (Exception ex)
    {
      Debug = "Failed to send log message: " + ex.Message
        + ((ex.InnerException == null) ? "" : " Inner: " + ex.InnerException.Message);
    }
# ---------- log_appinsights: C# additional code ----------
  public static string logUrl = "https://dc.services.visualstudio.com/v2/track";

  // Function to send log message to Azure Application Insights
  public string SendLogMessage(string instrumentationKey, Dictionary<string, string> properties)
  {
    string sendDebug = "";

    try
    {
      var propertyEntries = properties.Select(kvp => "\"" + kvp.Key + "\":\"" + kvp.Value + "\"");
      var propertiesJson = String.Join(",", propertyEntries);

      var logMessage = "{"
        + "\"name\":\"Microsoft.ApplicationInsights.Event\","
        + "\"time\":\"" + DateTime.UtcNow.ToString("O") + "\","
        + "\"iKey\":\"" + instrumentationKey + "\","
        + "\"data\":{"
        + "\"baseType\":\"EventData\","
        + "\"baseData\":{"
        + "\"ver\":2,"
        + "\"name\":\"Custom Log\","
        + "\"properties\":{" + propertiesJson + "}"
        + "}"
        + "}"
        + "}";

      var data = System.Text.Encoding.UTF8.GetBytes(logMessage);

      var request = System.Net.WebRequest.Create(logUrl);
      request.Method = "POST";
      request.ContentType = "application/json";
      request.Headers.Add("X-Api-Key", instrumentationKey);
      request.ContentLength = data.Length;

      using (var stream = request.GetRequestStream())
      {
        stream.Write(data, 0, data.Length);
      }

      using (var response = request.GetResponse() as System.Net.HttpWebResponse)
      {
        if (response.StatusCode != System.Net.HttpStatusCode.OK)
        {
          throw new Exception("Failed to send log message. Status code: " + response.StatusCode);
        }
      }
    }
    catch (Exception ex)
    {
      sendDebug = ex.Message + ".  Stack Trace: " + ex.StackTrace;
      if (ex.InnerException != null)
      {
        sendDebug += ". InnerException: " + ex.InnerException.Message;
      }
    }
    return sendDebug;
  }
# ---------- end log_appinsights ----------
debug = Debug(log_appinsights.Debug)
panel = Panel(log_appinsights.out)
