# Grasshopper definition simplify.gh (Grasshopper 1.0.7)

D = Data()
D_2 = Data(D)
tstat = TreeStatistics(Tree=D_2)  # -> Paths, Length, Count
larger = LargerThan(FirstNumber=tstat.Count, SecondNumber="1")  # -> LargerThan, OrEqualTo
simplify = SimplifyTree(Tree=D_2, Front=False)
flatten = FlattenTree(Tree=D_2, Path="{0}")
filter = StreamFilter(Gate=larger.LargerThan, Stream0=flatten, Stream1=simplify)
D_3 = Data(filter)
D_4 = Data(D_3)
