# Grasshopper definition time_gate.gh (Grasshopper 1.0.7)

D = Data()
D_2 = Data(D)
c_script = CSharpScript(Inputs=D_2)  # -> out, Inputs_out, TimeNowUtc; inputs Inputs: tree
# ---------- c_script: C# ----------
    TimeNowUtc = DateTime.UtcNow;
    Inputs_out = Inputs;
# ---------- end c_script ----------
utc = Time(c_script.TimeNowUtc)
D_3 = Data(c_script.Inputs_out)
D_4 = Data(D_3)
utc_2 = Time(utc)
