# Grasshopper definition time_span.gh (Grasshopper 1.0.7)

start = Start()
end = End()
timespan = CSharpScript(Start=start, End=end)  # -> out, Span
# ---------- timespan: C# ----------
    Span = (End - Start);
# ---------- end timespan ----------
span = Span(timespan.Span)
