# Grasshopper definition zig_zag_polyline.gh (Grasshopper 1.0.8)

# This is the old C# component from Rhino 7
startpt = StartPt()
zigzags = ZigZags()
dir1 = Dir1()
dir2 = Dir2()
mirror = Mirror()
close = Close()
zigzag_polyline = CSharpScript(StartPt=startpt, ZigZags=zigzags, Dir1=dir1, Dir2=dir2, Mirror=mirror, Close=close)  # -> out, Pl; inputs StartPt: Point3d, ZigZags: list of Double, Dir1: Vector3d, Dir2: Vector3d, Mirror: Boolean, Close: Boolean
# ---------- zigzag_polyline: C# usings ----------
using System.Linq;
# ---------- zigzag_polyline: C# ----------
    if (StartPt == null) return;

    List<Point3d> pts = new List<Point3d>() { StartPt };

    List<double> zigZags = ZigZags.ToList();

    List<double> temp = zigZags.ToList();

    for (int i = 0; i < zigZags.Count; i++)
    {
      pts.Add(pts.Last() + zigZags[i] * (((i % 2) == 0) ? Dir1 : Dir2));
    }

    if (Mirror && ZigZags.Count >= 2)
    {
      int multiplier = -1;
      for (int i = (zigZags.Count - 2); i >= 0; i--)
      {
        pts.Add(pts.Last() + zigZags[i] * multiplier * (((i % 2) == 0) ? Dir1 : Dir2));
        multiplier *= -1;
        temp.Add(zigZags[i] * (((i % 2) == 0) ? 1 : -1));
      }
    }
    if (Close)
    {
      pts.Add(pts.First());
    }

    Print(string.Join(",", temp));
    Pl = new PolylineCurve(pts);
# ---------- end zigzag_polyline ----------
pl = Pl(zigzag_polyline.Pl)
panel = Panel(zigzag_polyline.out)
